# Grasshopper definition BoundariesandIndex.gh (Grasshopper 0.9.76)
# plug-ins: ClipperComponents, HDTReference

# ---- group: Newly inserted road
crv = Curve(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)

# ----
list = ValueList({"Round  (0)": 0, "Square  (1)": 1, "Butt       (2)": 2}, selected="Butt       (2)")
list_2 = ValueList({"Round  (0)": 0, "Square (1)": 1, "Miter   (2)": 2}, selected="Miter   (2)")
list_3 = ValueList({"Round  (0)": 0, "Square  (1)": 1, "Butt       (2)": 2}, selected="Butt       (2)")
list_4 = ValueList({"Round  (0)": 0, "Square (1)": 1, "Miter   (2)": 2}, selected="Miter   (2)")
C = ColourSwatch(SwatchColor=RGB(0, 72, 255))

road_centerlines_crv = Curve([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])
road_centerlines_crv_2 = Curve([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])
road_setback = Slider(7.5, range=0..100)
road_setback_2 = Slider(12, range=0..100)
road_setback_3 = Slider(16, range=0..100)
road_centerlines_crv_3 = Curve([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])
road_centerlines_crv_4 = Curve(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)
road_setback_4 = Slider(9, range=0..100)
list_5 = ValueList({"Round  (0)": 0, "Square  (1)": 1, "Butt       (2)": 2}, selected="Butt       (2)")
list_6 = ValueList({"Round  (0)": 0, "Square (1)": 1, "Miter   (2)": 2}, selected="Miter   (2)")
list_7 = ValueList({"Round  (0)": 0, "Square  (1)": 1, "Butt       (2)": 2}, selected="Butt       (2)")
list_8 = ValueList({"Round  (0)": 0, "Square (1)": 1, "Miter   (2)": 2}, selected="Miter   (2)")
polyoffset = PolylineOffset(
    Polylines=road_centerlines_crv_4,
    Distance=road_setback_4,
    Plane=Plane(origin=(0, 0, 0), x=(0, 0, 0), y=(0, 0, 0)),
    Tolerance=0.001,
    ClosedFillet=list_8,
    OpenFillet=list_7,
    Miter=2)  # -> Contour, Holes

new_roads_merge_here = Merge(Data1=road_centerlines_crv_2, Data2=crv)
polyoffset_2 = PolylineOffset(
    Polylines=graft(road_centerlines_crv_3),
    Distance=graft(road_setback_3),
    Plane=Plane(origin=(0, 0, 0), x=(0, 0, 0), y=(0, 0, 0)),
    Tolerance=0.001,
    ClosedFillet=list_2,
    OpenFillet=list,
    Miter=2)  # -> flatten(Contour), Holes
polyoffset_3 = PolylineOffset(
    Polylines=graft(road_centerlines_crv),
    Distance=graft(road_setback_2),
    Plane=Plane(origin=(0, 0, 0), x=(0, 0, 0), y=(0, 0, 0)),
    Tolerance=0.001,
    ClosedFillet=list_4,
    OpenFillet=list_3,
    Miter=2)  # -> flatten(Contour), Holes

polyoffset_4 = PolylineOffset(
    Polylines=graft(new_roads_merge_here),
    Distance=graft(road_setback),
    Plane=Plane(origin=(0, 0, 0), x=(0, 0, 0), y=(0, 0, 0)),
    Tolerance=0.001,
    ClosedFillet=list_6,
    OpenFillet=list_5,
    Miter=2)  # -> flatten(Contour), Holes
rdiff = RegionDifference(CurvesA=polyoffset.Holes, CurvesB=[polyoffset_4.Contour, polyoffset_3.Contour, polyoffset_2.Contour])

ungroup = Ungroup(Group=rdiff)

number_slider = Slider(0, range=0..7)
list_9 = ValueList({"byXthenbyY": 1, "byYthenbyX": 2}, selected="byYthenbyX")
brep = Brep(rdiff)
c_order = CSharpScript(bList=brep, sortOrder=list_9)  # -> out, centroidsOrdered, bListOrdered; inputs bList: list of Brep, sortOrder: Int32
# ---------- c_order: C# ----------
    // by The Lord of SardineLand, Prince of NoMansLand
    
    List<Point3d> centroids = new List<Point3d> ();
    
    for(int i = 0; i < bList.Count;i++){
      Brep b = bList[i];
      Point3d cent = AreaMassProperties.Compute(b).Centroid;
      centroids.Add(cent);
    }    
    
    switch(sortOrder){
      case 1: centroidsOrd = centroids.OrderBy(x => x.X).ThenBy(x => x.Y).ToList();break;
      case 2: centroidsOrd = centroids.OrderBy(x => x.Y).ThenBy(x => x.X).ToList();break;
    }
    centroidsOrdered = centroidsOrd;

    List<Brep> bListOrder = new List<Brep> ();

    for(int i = 0; i < centroids.Count;i++){ //-- what does this mister? That's the 1M question
      bListOrder.Add(bList.ElementAt(centroids.IndexOf(centroidsOrd.ElementAt(i))));
    }
    bListOrdered = bListOrder;
# ---------- c_order: C# additional code ----------
  public List<Point3d> centroidsOrd;
# ---------- end c_order ----------
new_points = PointList(Points=c_order.centroidsOrdered, Size=Slider(46, range=1..80))

C_2 = ColourSwatch(SwatchColor=RGB(0, 0, 0))
index = ItemIndex(List=rdiff, Item=rdiff)
area = Area(Geometry=rdiff)  # -> Area, Centroid
previewlw = CustomPreviewLineweights(Geometry=flatten([rdiff, polyoffset.Contour]), Shader=C_2, Thickness=2)
boundary = BoundarySurfaces(Edges=flatten([rdiff, polyoffset.Contour]))
C_3 = ColourSwatch(SwatchColor=RGB(0, 72, 255))
yellow = Yellow(
    Geometry=boundary,
    Shader={ambient=RGB(128, 128, 128), diffuse=RGB(255, 255, 0), emission=RGB(64, 64, 0), shine=0.5, specular=RGB(255, 255, 255), transparency=0})
old_tag = TextTag(Location=area.Centroid, Text=index, Colour=C_3)

item = ListItem(List=brep, Index=number_slider, Wrap=True)
preview = CustomPreview(Geometry=item, Shader=ColourSwatch(SwatchColor=RGBA(236, 118, 255, 107)))

# ---- group: Find the closest IDs to the new lines
eval = EvaluateCurve(Curve=reparameterize(crv), Parameter="0.5")  # -> graft(Point), Tangent, Angle
dist = Distance(PointA=c_order.centroidsOrdered, PointB=eval.Point)

# ----
item_2 = ListItem(List=c_order.bListOrdered, Index=number_slider, Wrap=True)
preview_2 = CustomPreview(Geometry=item_2, Shader=ColourSwatch(SwatchColor=RGBA(65, 131, 255, 107)))

# ---- group: Get the IDs of them
sort = SortList(Keys=dist)  # -> Keys, ValuesA
item_3 = ListItem(List=sort.ValuesA, Index="1", Wrap=True)  # -> flatten(Item)

# ----
index_2 = ItemIndex(List=c_order.bListOrdered, Item=c_order.bListOrdered)

# ---- group: Get the points of the new items
item_4 = ListItem(List=c_order.centroidsOrdered, Index=item_3, Wrap=True)

# ---- group: Delete the points that are new
cull_i = CullIndex(List=c_order.centroidsOrdered, Indices=item_3, Wrap=True)

# ---- group: Insert them at the end
ins = InsertItems(List=cull_i, Item=item_4, Indices="-1", Wrap=True)

# ----
old_tag_2 = TextTag(Location=ins, Text=index_2, Colour=C)
