# Grasshopper definition drawbrepswithcolours.gh (Grasshopper 1.0.4)

panel = Panel("""SkyBlue
Orange
YellowGreen
DeepPink
Crimson""")
col = Colour(panel)
brep = Brep([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])
c_script = CSharpScript(B=brep, C=col)  # -> out; inputs B: Brep, C: Color
# ---------- c_script: C# ----------
    if (B == null) return;
    if (C.A == 0) return;

    _breps.Add(B);
    _materials.Add(new Rhino.Display.DisplayMaterial(C));
# ---------- c_script: C# additional code ----------
  private readonly List<Brep> _breps = new List<Brep>();
  private readonly List<Rhino.Display.DisplayMaterial> _materials = new List<Rhino.Display.DisplayMaterial>();
  private BoundingBox _box;

  /// <summary>
  /// This method will be called once every solution, before any calls to RunScript.
  /// </summary>
  public override void BeforeRunScript()
  {
    _box = BoundingBox.Empty;
    _breps.Clear();
    _materials.Clear();
  }

  public override BoundingBox ClippingBox
  {
    get { return _box; }
  }
  public override void DrawViewportMeshes(IGH_PreviewArgs args)
  {
    for (int i = 0; i < _breps.Count; i++)
     args.Display.DrawBrepWires(_breps[i], _materials[i].Diffuse, 0);
  }
  public override void DrawViewportWires(IGH_PreviewArgs args)
  {
    for (int i = 0; i < _breps.Count; i++)
      args.Display.DrawBrepShaded(_breps[i], _materials[i]);
  }
# ---------- end c_script ----------
