# Grasshopper definition urban_06.gh (Grasshopper 1.0.7)
# plug-ins: Urbano, Pufferfish

number_slider = Slider(5, range=1..15)
time_of_day = GetInteger(Slider(15, range=8..24), AtLeast=1, AtMost=1, Maximum=2147483647, Minimum=-2147483648, TreeAccess=False)
office_increment = GetInteger(Slider(1, range=0..100), AtLeast=1, AtMost=1, Maximum=2147483647, Minimum=-2147483648, TreeAccess=False)
residential_increment = GetInteger(Slider(68, range=0..100), AtLeast=1, AtMost=1, Maximum=2147483647, Minimum=-2147483648, TreeAccess=False)
land_plot_number = GetInteger(Slider(300, range=0..500), AtLeast=1, AtMost=1, Maximum=2147483647, Minimum=-2147483648, TreeAccess=False)
walk_radius = GetInteger(number_slider, AtLeast=1, AtMost=1, Maximum=2147483647, Minimum=-2147483648, TreeAccess=False)
travel_mode = GetInteger(Slider(1, range=0..3), AtLeast=1, AtMost=1, Maximum=2147483647, Minimum=-2147483648, TreeAccess=False)
c_script = CSharpScript()  # -> out, A
# ---------- c_script: C# ----------
      A =  Environment.GetFolderPath(Environment.SpecialFolder.UserProfile);
# ---------- end c_script ----------
concatenate = Concatenate(FragmentA=c_script.A, FragmentB="\Georgios\osmfile.osm")
file_path = FilePath(concatenate)
download_openstreetmap_osm = DownloadOpenStreetMapOSM(
    LeftBound=Slider(-74.00025, range=-100..100),
    RightBound=Slider(-73.99374, range=-100..100),
    TopBound=Slider(40.73353, range=0..100),
    BottomBound=Slider(40.72647, range=0..100),
    FilePath=file_path,
    RunToggle=True)  # -> OSMQueryURL, OSMFilePath
import_osm_features = ImportOSMFeatures(OSMPathOrURL=download_openstreetmap_osm.OSMQueryURL, OSMFeatureType="building", Format="xml", ImportAltitude=False)  # -> Points, Metadata, UTMZone, TranslationVector
import_osm_features_2 = ImportOSMFeatures(OSMPathOrURL=download_openstreetmap_osm.OSMQueryURL, OSMFeatureType="amenity", Format="xml", ImportAltitude=False)  # -> Points, Metadata, UTMZone, TranslationVector
import_osm_features_3 = ImportOSMFeatures(OSMPathOrURL=download_openstreetmap_osm.OSMQueryURL, OSMFeatureType="street", Format="xml", ImportAltitude=False)  # -> Points, Metadata, UTMZone, TranslationVector
lookup_metadata = LookupMetadata(MetadataGeometry=import_osm_features_2.Metadata, SearchKey="amenity")
amenity_capacity = AmenityCapacity(
    Activity=lookup_metadata,
    Area=-1,
    LogisticsAreaProportion=0.2,
    AmenityCapacityData="""post_office, 5, 15
bank, 5, 15
cinema, 1, 248
theatre, 1, 215
arts_centre, 3, 20
department_store, 1, 78
supermarket_store, 2, 32
convenience_store, 1, 39
hardware_store, 1, 50
pharmacy, 1, 42
restaurant, 2, 35
fast_food, 1, 36
cafe, 1, 50
bar, 1, 47
pub, 1, 47
clothes_store, 2, 21
books_store, 1, 26
beauty_store, 1, 27
shoes_store, 1, 38""")
polyline = PolyLine(Vertices=import_osm_features_3.Points, Closed=False)
polyline_2 = PolyLine(Vertices=import_osm_features.Points, Closed=False)
point = Point(import_osm_features_2.Points)
list_item = ListItem(List=flatten(polyline_2), Index=land_plot_number, Wrap=True)
merge_metadata = MergeMetadata(Metadata=amenity_capacity, Metadata_2=import_osm_features_2.Metadata)
area = Area(Geometry=list_item)  # -> Area, Centroid
create_amenity = CreateAmenity(PointLocationOfAmenity=point, Metadata=merge_metadata)
multiplication = Multiplication(A=residential_increment, B=area.Area)
multiplication_2 = Multiplication(A=office_increment, B=area.Area)
create_street_network = CreateStreetNetwork(
    StreetCurves=flatten(polyline),
    Metadata=flatten(import_osm_features_3.Metadata),
    SplitStreetCurves=False,
    UTMZone=import_osm_features_3.UTMZone,
    TranslationVector=import_osm_features_3.TranslationVector)  # -> StreetNetwork, StreetSegmentCurves, UTMZone, TranslationVector
building_population = BuildingPopulation(
    ResidentialArea=multiplication,
    ResidentialAreaPerPerson=40,
    OfficeArea=multiplication_2,
    OfficeAreaPerPerson=14,
    LogisticsAreaProportion=0.2)
arrange_amenities_by_building = ArrangeAmenitiesByBuilding(Amenities=flatten(create_amenity), Buildings=flatten(polyline_2))  # -> AmenitiesByBuilding, Buildings
merge_metadata_2 = MergeMetadata(Metadata=import_osm_features.Metadata, Metadata_2=building_population)  # -> graft(Metadata)
create_building = CreateBuilding(
    BuildingCurve=polyline_2,
    Metadata=merge_metadata_2,
    AmenitiesInBuilding=arrange_amenities_by_building.AmenitiesByBuilding)
division = Division(A=office_increment, B="2")
division_2 = Division(A=residential_increment, B="2")
unit_z = UnitZ(Factor=division)
unit_z_2 = UnitZ(Factor=division_2)
extrude = Extrude(Base=list_item, Direction=unit_z)
extrude_2 = Extrude(Base=list_item, Direction=unit_z_2)
build_urbano_model = BuildUrbanoModel(Buildings=flatten(create_building), StreetNetwork=create_street_network.StreetNetwork, BuildToggle=True)  # -> UrbanoModel, BuildingCurves, Activities
panel = Panel("residential_population")  # disabled
cap_holes = CapHoles(Brep=extrude)
cap_holes_2 = CapHoles(Brep=extrude_2)
mesh_colours = MeshColours(Mesh=cap_holes, Colours=ColourSwatch(SwatchColor=RGBA(0, 0, 0, 131)))
mesh_colours_2 = MeshColours(Mesh=cap_holes_2, Colours=ColourSwatch(SwatchColor=RGBA(0, 0, 0, 131)))
lookup_metadata_2 = LookupMetadata(MetadataGeometry=create_building, SearchKey=panel)  # disabled
list_item_2 = ListItem(List=flatten(build_urbano_model.BuildingCurves), Index=land_plot_number, Wrap=True)
panel_2 = Panel(lookup_metadata_2)  # disabled
panel_3 = Panel(build_urbano_model.Activities)  # disabled
panel_4 = Panel("""Pedestrian
Car
Bike
Bus""")
# Activity Demand
activity_demand_profile_persona = ActivityDemandProfilePersona(
    ColumnIndex=time_of_day,
    Normalize=False,
    Persona="""post_office,0,0,0,0,0,0,0,0,0,0,0,0,0.001,0.001,0.001,0.001,0,0,0,0,0,0,0,0
bank,0,0,0,0,0,0,0,0,0,0,0.004,0.006,0.006,0.006,0.004,0.002,0.002,0.002,0.002,0.002,0.002,0.002,0.002,0
cinema,0,0,0,0,0,0,0,0,0,0,0,0.008,0.017,0.03,0.046,0.059,0.067,0.072,0.075,0.077,0.075,0.066,0.048,0.03
theatre,0.007,0.003,0,0,0,0,0,0,0,0,0,0.002,0.011,0.033,0.064,0.062,0.034,0.02,0.025,0.053,0.028,0.026,0.021,0.013
arts_centre,0,0,0,0,0,0,0,0,0,0.003,0.003,0.007,0.01,0.01,0.007,0.007,0.007,0.007,0.007,0.01,0.01,0.007,0,0
pharmacy,0.016,0.008,0.005,0.003,0.003,0.003,0.003,0.005,0.008,0.016,0.027,0.035,0.046,0.052,0.06,0.065,0.065,0.063,0.057,0.049,0.044,0.038,0.03,0.022
restaurant,0.041,0.031,0.021,0.01,0,0,0,0.01,0.01,0.031,0.062,0.103,0.175,0.217,0.206,0.175,0.165,0.186,0.206,0.217,0.186,0.134,0.083,0.041
fast_food,0.003,0.003,0.003,0.001,0.001,0.001,0.002,0.004,0.003,0.003,0.005,0.007,0.012,0.017,0.017,0.015,0.013,0.013,0.013,0.012,0.011,0.007,0.003,0.002
cafe,0,0,0,0,0,0,0.006,0.017,0.031,0.044,0.055,0.058,0.064,0.069,0.075,0.075,0.069,0.058,0.044,0.033,0.017,0.011,0.006,0
bar,0.118,0.084,0.049,0.023,0,0,0,0,0,0,0.003,0.013,0.031,0.044,0.051,0.056,0.064,0.077,0.087,0.095,0.097,0.1,0.102,0.092
pub,0.118,0.084,0.049,0.023,0,0,0,0,0,0,0.003,0.013,0.031,0.044,0.051,0.056,0.064,0.077,0.087,0.095,0.097,0.1,0.102,0.092
department_store,0,0,0,0,0,0,0,0,0.001,0.002,0.005,0.009,0.014,0.017,0.019,0.022,0.022,0.02,0.015,0.011,0.007,0.003,0,0
supermarket_store,0.004,0.002,0.002,0.002,0.002,0.002,0.002,0.004,0.011,0.019,0.026,0.032,0.036,0.04,0.047,0.051,0.055,0.055,0.051,0.043,0.032,0.023,0.015,0.009
convenience_store,0.005,0.004,0.004,0.004,0.003,0.002,0.002,0.002,0.002,0.003,0.004,0.005,0.006,0.007,0.007,0.006,0.005,0.005,0.005,0.006,0.005,0.005,0.004,0.004
hardware_store,0,0,0,0,0,0,0,0,0,0.001,0.003,0.005,0.007,0.007,0.007,0.008,0.007,0.005,0.003,0.001,0.001,0.001,0.001,0.001
clothes_store,0,0,0,0,0,0,0,0,0,0,0.022,0.066,0.099,0.121,0.143,0.154,0.154,0.121,0.077,0.055,0.022,0.011,0,0
books_store,0,0,0,0,0,0,0,0,0,0.001,0.002,0.005,0.009,0.012,0.012,0.013,0.013,0.01,0.006,0.005,0.002,0.001,0,0
shoes_store,0,0,0,0,0,0,0,0,0,0.002,0.006,0.014,0.025,0.031,0.039,0.04,0.04,0.037,0.029,0.017,0.006,0.002,0.002,0
beauty_store,0,0,0,0,0,0,0,0,0,0.005,0.019,0.027,0.032,0.035,0.04,0.042,0.042,0.035,0.027,0.014,0.006,0.003,0.002,0""")
list_item_3 = ListItem(List=panel_4, Index=travel_mode, Wrap=True)
adp_trip_engine = ADPTripEngine(
    UrbanoModel=build_urbano_model.UrbanoModel,
    Building=list_item_2,
    ActivityDemandProfile=activity_demand_profile_persona,
    SingleTravelMode=list_item_3,
    DestinationChoiceModel="by_destination_factor",
    DestinationFactorKeys="amenity_capacity",
    TimeLimit=number_slider,
    BuildToggle=True)
amenity_hits = AmenityHits(Trips=flatten(adp_trip_engine))  # -> Amenity, AmenityHits, AmenityHosts, Trips
street_hits = StreetHits(UrbanoModel=build_urbano_model.UrbanoModel, Trips=flatten(adp_trip_engine))  # -> StreetCurves, StreetHits, Trips
inspect_trip = InspectTrip(Trip=adp_trip_engine)  # -> Origin, Destination, Time, Distance, Route, Mode, People, Activity, Amenity
average = Average(Input=inspect_trip.Distance)  # -> flatten(ArithmeticMean)
average_2 = Average(Input=inspect_trip.Time)  # -> flatten(ArithmeticMean)
average_3 = Average(Input=inspect_trip.People)  # -> flatten(ArithmeticMean)
bounds = Bounds(Numbers=street_hits.StreetHits)
clean_tree = CleanTree(RemoveNulls=True, RemoveInvalid=True, RemoveEmpty=False, Tree=average_2)
clean_tree_2 = CleanTree(RemoveNulls=True, RemoveInvalid=True, RemoveEmpty=False, Tree=average)
clean_tree_3 = CleanTree(RemoveNulls=True, RemoveInvalid=True, RemoveEmpty=False, Tree=average_3)
bounds_2 = Bounds(Numbers=amenity_hits.AmenityHits)
panel_5 = Panel(clean_tree)
panel_6 = Panel(clean_tree_2)
panel_7 = Panel(clean_tree_3)
remap_numbers = RemapNumbers(Value=street_hits.StreetHits, Source=bounds, Target=Domain(0, 1))  # -> Mapped, Clipped
trip_amenityscore = TripAmenityscore(Trips=flatten(amenity_hits.Trips))  # -> Amenityscore, Amenity, AmenityHosts
inspect_amenity = InspectAmenity(Amenity=amenity_hits.Amenity)  # -> Name, flatten(Activities), Host, Metadata
remap_numbers_2 = RemapNumbers(Value=street_hits.StreetHits, Source=bounds, Target=Slider(50, range=0..50))  # -> Mapped, Clipped
unit_z_3 = UnitZ(Factor=remap_numbers_2.Mapped)
move = Move(Geometry=street_hits.StreetCurves, Motion=unit_z_3)  # -> Geometry, Transform
remap_numbers_3 = RemapNumbers(Value=amenity_hits.AmenityHits, Source=bounds_2, Target=Domain(0, 1))  # -> Mapped, Clipped
curve = Curve(amenity_hits.AmenityHosts)
context_print = ContextPrint(Duration=clean_tree)
context_print_2 = ContextPrint(Distance=clean_tree_2)
context_print_3 = ContextPrint(People=clean_tree_3)
unit_z_4 = UnitZ(Factor=expr("x*2", amenity_hits.AmenityHits))
area_2 = Area(Geometry=amenity_hits.AmenityHosts)  # -> Area, Centroid
ruled_surface = RuledSurface(CurveA=street_hits.StreetCurves, CurveB=move.Geometry)
gradient = Gradient(
    LowerLimit=Slider(0.64, range=0..1),
    UpperLimit=Slider(0, range=0..1),
    Parameter=remap_numbers_3.Mapped,
    stops=[0: RGB(210, 0, 118), 0: RGB(236, 27, 60), 0: RGB(243, 57, 0), 0: RGB(103, 0, 120), 0.494: RGB(105, 93, 161), 1: RGB(18, 178, 90), 1: RGB(1, 192, 229), 1: RGB(220, 237, 32), 1: RGB(79, 186, 8), 1: RGB(243, 57, 0), 1: RGB(247, 159, 20)])
extrude_3 = Extrude(Base=curve, Direction=unit_z_4)
gradient_2 = Gradient(
    LowerLimit=Slider(1, range=0..1),
    UpperLimit=Slider(0, range=0..1),
    Parameter=remap_numbers.Clipped,
    stops=[0: RGB(128, 0, 128), 0: RGB(173, 246, 244), 0: RGB(18, 178, 90), 0: RGB(1, 192, 229), 0: RGB(220, 237, 32), 0: RGB(79, 186, 8), 0: RGB(39, 72, 161), 0: RGB(236, 27, 60), 0: RGB(243, 57, 0), 0: RGB(103, 0, 120)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])
round_to_decimal_place = RoundToDecimalPlace(NumberX=street_hits.StreetHits, DecimalPlace="2", RoundType=0)  # -> Rounded, Difference
line_sdl = LineSDL(Start=area_2.Centroid, Direction=Vector(0, 0, 1), Length=amenity_hits.AmenityHits)
parameter_surface_mesh = ParameterSurfaceMesh(Surface=ruled_surface, ParametersU=[0, 0.25, 0.5, 0.75, 1], ParametersV=[0, 0.25, 0.5, 0.75, 1], Triangulate=False)
cap_holes_3 = CapHoles(Brep=extrude_3)
end_points = EndPoints(Curve=line_sdl)  # -> Start, End
round_to_decimal_place_2 = RoundToDecimalPlace(NumberX=trip_amenityscore.Amenityscore, DecimalPlace="2", RoundType=0)  # -> Rounded, Difference
unit_z_5 = UnitZ(Factor=1)
line_sdl_2 = LineSDL(Start=end_points.End, Direction=Vector(0, 0, 1), Length=amenity_hits.AmenityHits)
text_on_surface = TextOnSurface(
    Text=round_to_decimal_place.Rounded,
    Font="Sans Bold:no Italic:no",
    Height=Slider(2, range=0..10),
    Depth=Slider(0.5, range=0..1),
    BaseLine=move.Geometry,
    BaseSurface=parameter_surface_mesh)
curve_middle = CurveMiddle(Curve=move.Geometry)
end_points_2 = EndPoints(Curve=line_sdl_2)  # -> Start, End
mesh_colours_3 = MeshColours(Mesh=parameter_surface_mesh, Colours=gradient_2)
unit_z_6 = UnitZ(Factor=Slider(10, range=0..10))
triangulate = Triangulate(Mesh=cap_holes_3)  # -> Mesh, Count
line_sdl_3 = LineSDL(Start=end_points_2.End, Direction=unit_z_5, Length=Slider(50, range=0..100))
move_2 = Move(Geometry=curve_middle, Motion=unit_z_6)  # -> Geometry, Transform
area_3 = Area(Geometry=triangulate.Mesh)  # -> Area, Centroid
move_3 = Move(Geometry=text_on_surface, Motion=unit_z_6)  # -> Geometry, Transform
text_on_surface_2 = TextOnSurface(
    Text=inspect_amenity.Activities,
    Font="Sans Bold:no Italic:no",
    Height=Slider(3, range=0..10),
    Depth=0.4,
    BaseLine=line_sdl_3)  # -> flatten(Symbols)
line = Line(StartPoint=curve_middle, EndPoint=move_2.Geometry)
number_slider_2 = Slider(4, range=0..10)
yz_plane = YZPlane(Origin=Point(0, 0, 0))
mesh_spray = MeshSpray(Mesh=triangulate.Mesh, Points=area_3.Centroid, Colours=gradient, SprayMode=0)
plane_surface = PlaneSurface(Plane=yz_plane, XSize=number_slider_2, YSize=number_slider_2)
mesh_colours_4 = MeshColours(Mesh=text_on_surface_2, Colours=gradient)
text_on_surface_3 = TextOnSurface(
    Text=round_to_decimal_place_2.Rounded,
    Font="Sans Bold:no Italic:no",
    Height=Slider(4, range=0..10),
    Depth=0.4,
    BaseLine=line_sdl_3,
    BaseSurface=plane_surface)  # -> flatten(Symbols)
unit_z_7 = UnitZ(Factor=Slider(28, range=0..100))
move_4 = Move(Geometry=text_on_surface_3, Motion=unit_z_7)  # -> Geometry, Transform
mesh_colours_5 = MeshColours(Mesh=move_4.Geometry, Colours=gradient)
mesh_colours_6 = MeshColours(Mesh=move_3.Geometry, Colours=ColourSwatch(SwatchColor=RGBA(74, 74, 74, 160)))
create_set = CreateSet(List=inspect_amenity.Activities)  # -> flatten(Set), Map
geometry = Geometry(flatten(mesh_spray))
geometry_2 = Geometry(flatten(mesh_colours))
geometry_3 = Geometry(flatten(mesh_colours_3))
curve_2 = Curve(flatten(line_sdl_3))
geometry_4 = Geometry(flatten(mesh_colours_2))
geometry_5 = Geometry(mesh_colours_6)
curve_3 = Curve(flatten(line))
geometry_6 = Geometry(flatten(mesh_colours_5))
geometry_7 = Geometry(flatten(mesh_colours_4))

# ---- group: RH_OUT:Street Legend
geometry_8 = Geometry(curve_3)

# ---- group: RH_OUT:Office
geometry_9 = Geometry(geometry_2)

# ---- group: RH_OUT:Amenities Buildings
geometry_10 = Geometry(geometry)

# ---- group: RH_OUT:Street Hits
geometry_11 = Geometry(geometry_5)

# ---- group: RH_OUT:Residential
geometry_12 = Geometry(geometry_4)

# ---- group: RH_OUT:Amenities Pipes
geometry_13 = Geometry(curve_2)

# ---- group: RH_OUT:Street Loads
geometry_14 = Geometry(geometry_3)

# ---- group: RH_OUT:Amenities
geometry_15 = Geometry(geometry_7)

# ----
context_print_4 = ContextPrint(Text=create_set.Set)

# ---- group: RH_OUT:Amenities Scores
geometry_16 = Geometry(geometry_6)
