# Grasshopper definition urban_05.gh (Grasshopper 1.0.7)
# plug-ins: Urbano, Pufferfish

boolean_toggle = BooleanToggle(True)
file_path = FilePath("C:\Users\Georgios Bekakos\Desktop\URBANO\nyc.osm")
download_openstreetmap_osm = DownloadOpenStreetMapOSM(
    LeftBound="-74.00025",
    RightBound="-73.99374",
    TopBound="40.73353",
    BottomBound="40.72647",
    FilePath=file_path,
    RunToggle=True)  # -> OSMQueryURL, OSMFilePath
import_osm_features = ImportOSMFeatures(OSMPathOrURL=download_openstreetmap_osm.OSMQueryURL, OSMFeatureType="building", Format="xml", ImportAltitude=False)  # -> Points, Metadata, UTMZone, TranslationVector
import_osm_features_2 = ImportOSMFeatures(OSMPathOrURL=download_openstreetmap_osm.OSMQueryURL, OSMFeatureType="amenity", Format="xml", ImportAltitude=False)  # -> Points, Metadata, UTMZone, TranslationVector
import_osm_features_3 = ImportOSMFeatures(OSMPathOrURL=download_openstreetmap_osm.OSMQueryURL, OSMFeatureType="street", Format="xml", ImportAltitude=False)  # -> Points, Metadata, UTMZone, TranslationVector
land_plot_number = GetInteger(Slider(185, range=0..410), AtLeast=1, AtMost=1, Maximum=2147483647, Minimum=-2147483648, TreeAccess=False)
population_increment = GetInteger(Slider(127, range=0..250), AtLeast=1, AtMost=1, Maximum=2147483647, Minimum=-2147483648, TreeAccess=False)
lookup_metadata = LookupMetadata(MetadataGeometry=import_osm_features_2.Metadata, SearchKey="amenity")
amenity_capacity = AmenityCapacity(
    Activity=lookup_metadata,
    Area=-1,
    LogisticsAreaProportion=0.2,
    AmenityCapacityData="""post_office, 5, 15
bank, 5, 15
cinema, 1, 248
theatre, 1, 215
arts_centre, 3, 20
department_store, 1, 78
supermarket_store, 2, 32
convenience_store, 1, 39
hardware_store, 1, 50
pharmacy, 1, 42
restaurant, 2, 35
fast_food, 1, 36
cafe, 1, 50
bar, 1, 47
pub, 1, 47
clothes_store, 2, 21
books_store, 1, 26
beauty_store, 1, 27
shoes_store, 1, 38""")
polyline = PolyLine(Vertices=import_osm_features.Points, Closed=False)
polyline_2 = PolyLine(Vertices=import_osm_features_3.Points, Closed=False)
point = Point(import_osm_features_2.Points)
list_item = ListItem(List=flatten(polyline), Index=land_plot_number, Wrap=True)
lookup_metadata_2 = LookupMetadata(MetadataGeometry=import_osm_features.Metadata, SearchKey="height")
merge_metadata = MergeMetadata(Metadata=amenity_capacity, Metadata_2=import_osm_features_2.Metadata)
area = Area(Geometry=list_item)  # -> Area, Centroid
unit_z = UnitZ(Factor=lookup_metadata_2)
create_amenity = CreateAmenity(PointLocationOfAmenity=point, Metadata=merge_metadata)
multiplication = Multiplication(A=population_increment, B=area.Area)
building_population = BuildingPopulation(
    ResidentialArea=multiplication,
    ResidentialAreaPerPerson=40,
    OfficeArea=0,
    OfficeAreaPerPerson=14,
    LogisticsAreaProportion=0.2)
create_street_network = CreateStreetNetwork(
    StreetCurves=flatten(polyline_2),
    Metadata=flatten(import_osm_features_3.Metadata),
    SplitStreetCurves=False,
    UTMZone=import_osm_features_3.UTMZone,
    TranslationVector=import_osm_features_3.TranslationVector)  # -> StreetNetwork, StreetSegmentCurves, UTMZone, TranslationVector
extrude = Extrude(Base=polyline, Direction=unit_z)
arrange_amenities_by_building = ArrangeAmenitiesByBuilding(Amenities=flatten(create_amenity), Buildings=flatten(polyline))  # -> AmenitiesByBuilding, Buildings
gradient = Gradient(
    LowerLimit="0",
    UpperLimit="100",
    Parameter=lookup_metadata_2,
    stops=[0: RGBA(63, 101, 167, 131), 0.25: RGBA(126, 88, 130, 177), 0.5: RGBA(133, 131, 178, 150), 0.75: RGBA(181, 143, 162, 126), 1: RGBA(147, 70, 176, 148)])
cap_holes = CapHoles(Brep=extrude)
merge_metadata_2 = MergeMetadata(Metadata=import_osm_features.Metadata, Metadata_2=building_population)  # -> graft(Metadata)
area_2 = Area(Geometry=cap_holes)  # -> Area, Centroid
boundary_surfaces = BoundarySurfaces(Edges=polyline)
create_building = CreateBuilding(BuildingCurve=polyline, Metadata=merge_metadata_2, AmenitiesInBuilding=arrange_amenities_by_building.AmenitiesByBuilding)
mesh = Mesh(cap_holes)
geometry = Geometry(flatten(point))
geometry_2 = Geometry(flatten(boundary_surfaces))
geometry_3 = Geometry(flatten(polyline_2))
geometry_4 = Geometry(flatten(polyline))

# ---- group: RH_OUT:Block Lines
geometry_5 = Geometry(geometry_4)

# ---- group: RH_OUT:Roads
geometry_6 = Geometry(geometry_3)

# ---- group: RH_OUT:Total Amenities Points
geometry_7 = Geometry(geometry)

# ----
mesh_spray = MeshSpray(Mesh=mesh, Points=area_2.Centroid, Colours=gradient, SprayMode=11)

# ---- group: RH_OUT:Block Surfaces
geometry_8 = Geometry(geometry_2)

# ----
division = Division(A=population_increment, B="2")
unit_z_2 = UnitZ(Factor=division)
extrude_2 = Extrude(Base=list_item, Direction=unit_z_2)
build_urbano_model = BuildUrbanoModel(Buildings=flatten(create_building), StreetNetwork=create_street_network.StreetNetwork, BuildToggle=True)  # -> UrbanoModel, BuildingCurves, Activities
cap_holes_2 = CapHoles(Brep=extrude_2)
mesh_colours = MeshColours(Mesh=cap_holes_2, Colours=ColourSwatch(SwatchColor=RGB(0, 0, 0)))
geometry_9 = Geometry(flatten(mesh_colours))

# ---- group: RH_OUT:New Building
geometry_10 = Geometry(geometry_9)

# ----
lookup_metadata_3 = LookupMetadata(MetadataGeometry=create_building, SearchKey="residential_population")
list_item_2 = ListItem(List=flatten(build_urbano_model.BuildingCurves), Index=land_plot_number, Wrap=True)
panel = Panel(build_urbano_model.Activities)
list_item_3 = ListItem(List=flatten(lookup_metadata_3), Index=0, Wrap=True)
panel_2 = Panel(lookup_metadata_3)
area_3 = Area(Geometry=build_urbano_model.BuildingCurves)  # -> Area, Centroid
context_print = ContextPrint(AddedPopulation=list_item_3)
list_indices = ListIndices(List=build_urbano_model.BuildingCurves)
surface = Surface(flatten(polyline))
unit_y = UnitY(Factor=1)
line_sdl = LineSDL(Start=area_3.Centroid, Direction=unit_y, Length=Slider(6, range=0..10))
flip = Flip(Surface=surface)  # -> Surface, Result
text_on_surface = TextOnSurface(
    Text=list_indices,
    Font="Sans Bold:no Italic:no",
    Height=Slider(4, range=0..10),
    Depth=0.4,
    BaseLine=line_sdl,
    BaseSurface=flip.Surface)  # -> flatten(Symbols)
geometry_11 = Geometry(flatten(text_on_surface))

# ---- group: RH_OUT:Block Numbers
geometry_12 = Geometry(geometry_11)

# ----
number_slider = Slider(1, range=1..3, expression="x*5")
walk_minutes_radius = GetInteger(number_slider, AtLeast=1, AtMost=1, Maximum=2147483647, Minimum=-2147483648, TreeAccess=False)
# Travel Radius
router = Router(
    RouterUrbanoModelOrStreetNetwork=build_urbano_model.UrbanoModel,
    Origin=list_item_2,
    Destination=graft(build_urbano_model.BuildingCurves),
    TravelMode="pedestrian",
    TimeLimit=walk_minutes_radius)  # -> flatten(Trip), Route, Time, Distance
smaller_than = SmallerThan(FirstNumber=flatten(router.Time), SecondNumber=Slider(5, range=0..15))  # -> SmallerThan, OrEqualTo
hours = GetInteger(Slider(15, range=8..24), AtLeast=1, AtMost=1, Maximum=2147483647, Minimum=-2147483648, TreeAccess=False)
dispatch = Dispatch(List=router.Trip, DispatchPattern=smaller_than.SmallerThan)  # -> ListA, flatten(ListB)
# Activity Demand
activity_demand_profile_persona = ActivityDemandProfilePersona(
    ColumnIndex=hours,
    Normalize=False,
    Persona="""post_office,0,0,0,0,0,0,0,0,0,0,0,0,0.001,0.001,0.001,0.001,0,0,0,0,0,0,0,0
bank,0,0,0,0,0,0,0,0,0,0,0.004,0.006,0.006,0.006,0.004,0.002,0.002,0.002,0.002,0.002,0.002,0.002,0.002,0
cinema,0,0,0,0,0,0,0,0,0,0,0,0.008,0.017,0.03,0.046,0.059,0.067,0.072,0.075,0.077,0.075,0.066,0.048,0.03
theatre,0.007,0.003,0,0,0,0,0,0,0,0,0,0.002,0.011,0.033,0.064,0.062,0.034,0.02,0.025,0.053,0.028,0.026,0.021,0.013
arts_centre,0,0,0,0,0,0,0,0,0,0.003,0.003,0.007,0.01,0.01,0.007,0.007,0.007,0.007,0.007,0.01,0.01,0.007,0,0
pharmacy,0.016,0.008,0.005,0.003,0.003,0.003,0.003,0.005,0.008,0.016,0.027,0.035,0.046,0.052,0.06,0.065,0.065,0.063,0.057,0.049,0.044,0.038,0.03,0.022
restaurant,0.041,0.031,0.021,0.01,0,0,0,0.01,0.01,0.031,0.062,0.103,0.175,0.217,0.206,0.175,0.165,0.186,0.206,0.217,0.186,0.134,0.083,0.041
fast_food,0.003,0.003,0.003,0.001,0.001,0.001,0.002,0.004,0.003,0.003,0.005,0.007,0.012,0.017,0.017,0.015,0.013,0.013,0.013,0.012,0.011,0.007,0.003,0.002
cafe,0,0,0,0,0,0,0.006,0.017,0.031,0.044,0.055,0.058,0.064,0.069,0.075,0.075,0.069,0.058,0.044,0.033,0.017,0.011,0.006,0
bar,0.118,0.084,0.049,0.023,0,0,0,0,0,0,0.003,0.013,0.031,0.044,0.051,0.056,0.064,0.077,0.087,0.095,0.097,0.1,0.102,0.092
pub,0.118,0.084,0.049,0.023,0,0,0,0,0,0,0.003,0.013,0.031,0.044,0.051,0.056,0.064,0.077,0.087,0.095,0.097,0.1,0.102,0.092
department_store,0,0,0,0,0,0,0,0,0.001,0.002,0.005,0.009,0.014,0.017,0.019,0.022,0.022,0.02,0.015,0.011,0.007,0.003,0,0
supermarket_store,0.004,0.002,0.002,0.002,0.002,0.002,0.002,0.004,0.011,0.019,0.026,0.032,0.036,0.04,0.047,0.051,0.055,0.055,0.051,0.043,0.032,0.023,0.015,0.009
convenience_store,0.005,0.004,0.004,0.004,0.003,0.002,0.002,0.002,0.002,0.003,0.004,0.005,0.006,0.007,0.007,0.006,0.005,0.005,0.005,0.006,0.005,0.005,0.004,0.004
hardware_store,0,0,0,0,0,0,0,0,0,0.001,0.003,0.005,0.007,0.007,0.007,0.008,0.007,0.005,0.003,0.001,0.001,0.001,0.001,0.001
clothes_store,0,0,0,0,0,0,0,0,0,0,0.022,0.066,0.099,0.121,0.143,0.154,0.154,0.121,0.077,0.055,0.022,0.011,0,0
books_store,0,0,0,0,0,0,0,0,0,0.001,0.002,0.005,0.009,0.012,0.012,0.013,0.013,0.01,0.006,0.005,0.002,0.001,0,0
shoes_store,0,0,0,0,0,0,0,0,0,0.002,0.006,0.014,0.025,0.031,0.039,0.04,0.04,0.037,0.029,0.017,0.006,0.002,0.002,0
beauty_store,0,0,0,0,0,0,0,0,0,0.005,0.019,0.027,0.032,0.035,0.04,0.042,0.042,0.035,0.027,0.014,0.006,0.003,0.002,0""")
inspect_trip = InspectTrip(Trip=dispatch.ListA)  # -> Origin, Destination, Time, Distance, Route, Mode, People, Activity, Amenity
adp_trip_engine = ADPTripEngine(
    UrbanoModel=build_urbano_model.UrbanoModel,
    Building=list_item_2,
    ActivityDemandProfile=activity_demand_profile_persona,
    SingleTravelMode="pedestrian",
    DestinationChoiceModel="by_destination_factor",
    DestinationFactorKeys="amenity_capacity",
    TimeLimit=number_slider,
    BuildToggle=True)
average = Average(Input=inspect_trip.Time)
average_2 = Average(Input=inspect_trip.Distance)
average_3 = Average(Input=inspect_trip.People)
curve = Curve(inspect_trip.Route)
panel_3 = Panel(average)
panel_4 = Panel(average_2)
amenity_hits = AmenityHits(Trips=flatten(adp_trip_engine))  # -> Amenity, AmenityHits, AmenityHosts, Trips
pipe = Pipe(Curve=curve, Radius=1, Caps=Slider(2, range=0..2))
street_hits = StreetHits(UrbanoModel=build_urbano_model.UrbanoModel, Trips=flatten(adp_trip_engine))  # -> StreetCurves, StreetHits, Trips
inspect_trip_2 = InspectTrip(Trip=adp_trip_engine)  # -> Origin, Destination, Time, Distance, Route, Mode, People, Activity, Amenity
inspect_trip_3 = InspectTrip(Trip=adp_trip_engine)  # -> Origin, Destination, Time, Distance, Route, Mode, People, Activity, Amenity
mesh_colours_2 = MeshColours(Mesh=flatten(pipe), Colours=ColourSwatch(SwatchColor=RGB(2, 0, 0)))

# ---- group: RH_OUT:Trip Time
context_print_2 = ContextPrint(TripTime=average)

# ---- group: RH_OUT:Distance
context_print_3 = ContextPrint(Distance=average_2)

# ----
panel_5 = Panel(inspect_trip_2.People)
average_4 = Average(Input=inspect_trip_3.Distance)  # -> flatten(ArithmeticMean)
average_5 = Average(Input=inspect_trip_3.Time)  # -> flatten(ArithmeticMean)
average_6 = Average(Input=inspect_trip_3.People)  # -> flatten(ArithmeticMean)
curve_2 = Curve(inspect_trip_3.Route)

# ---- group: RH_OUT:Max Trip 3D
geometry_13 = Geometry(mesh_colours_2)

# ----
panel_6 = Panel(street_hits.StreetHits)
clean_tree = CleanTree(RemoveNulls=True, RemoveInvalid=True, RemoveEmpty=False, Tree=average_5)
clean_tree_2 = CleanTree(RemoveNulls=True, RemoveInvalid=True, RemoveEmpty=False, Tree=average_4)
clean_tree_3 = CleanTree(RemoveNulls=True, RemoveInvalid=True, RemoveEmpty=False, Tree=average_6)
bounds = Bounds(Numbers=street_hits.StreetHits)
bounds_2 = Bounds(Numbers=amenity_hits.AmenityHits)
panel_7 = Panel(clean_tree)
panel_8 = Panel(clean_tree_2)
panel_9 = Panel(clean_tree_3)
trip_amenityscore = TripAmenityscore(Trips=flatten(amenity_hits.Trips))  # -> Amenityscore, Amenity, AmenityHosts
inspect_amenity = InspectAmenity(Amenity=amenity_hits.Amenity)  # -> Name, flatten(Activities), Host, Metadata
remap_numbers = RemapNumbers(Value=street_hits.StreetHits, Source=bounds, Target=Domain(0, 1))  # -> Mapped, Clipped
number_slider_2 = Slider(2, range=0..10)
remap_numbers_2 = RemapNumbers(Value=street_hits.StreetHits, Source=bounds, Target=Slider(50, range=0..50))  # -> Mapped, Clipped
unit_z_3 = UnitZ(Factor=remap_numbers_2.Mapped)
move = Move(Geometry=street_hits.StreetCurves, Motion=unit_z_3)  # -> Geometry, Transform
remap_numbers_3 = RemapNumbers(Value=amenity_hits.AmenityHits, Source=bounds_2, Target=Domain(0, 1))  # -> Mapped, Clipped
remap_numbers_4 = RemapNumbers(Value=amenity_hits.AmenityHits, Source=bounds_2, Target=Slider(77, range=0..500))  # -> Mapped, Clipped
explode = Explode(Curve=move.Geometry, Recursive=True)  # -> Segments, Vertices
unit_z_4 = UnitZ(Factor=amenity_hits.AmenityHits)
area_4 = Area(Geometry=amenity_hits.AmenityHosts)  # -> Area, Centroid
edge_surface = EdgeSurface(CurveA=street_hits.StreetCurves, CurveB=move.Geometry)
gradient_2 = Gradient(
    LowerLimit=Slider(0.74, range=0..1),
    UpperLimit=Slider(0.14, range=0..1),
    Parameter=remap_numbers_3.Mapped,
    stops=[0: RGBA(255, 186, 54, 116), 0.25: RGBA(129, 150, 60, 128), 0.5: RGBA(0, 89, 20, 98), 0.75: RGBA(42, 126, 82, 168), 1: RGBA(0, 99, 255, 91)])
extrude_3 = Extrude(Base=amenity_hits.AmenityHosts, Direction=unit_z_4)
round_to_decimal_place = RoundToDecimalPlace(NumberX=street_hits.StreetHits, DecimalPlace="2", RoundType=0)  # -> Rounded, Difference
gradient_3 = Gradient(
    LowerLimit=Slider(1, range=0..1),
    UpperLimit=Slider(0, range=0..1),
    Parameter=remap_numbers.Clipped,
    stops=[0: RGBA(255, 186, 255, 116), 0.25: RGBA(175, 158, 255, 128), 0.5: RGBA(101, 147, 255, 98), 0.75: RGBA(118, 240, 207, 168), 1: RGBA(255, 190, 122, 91)])
line_sdl_2 = LineSDL(Start=area_4.Centroid, Direction=Vector(0, 0, 1), Length=amenity_hits.AmenityHits)
unit_z_5 = UnitZ(Factor=1)
cap_holes_3 = CapHoles(Brep=extrude_3)
brep = Brep(edge_surface)
end_points = EndPoints(Curve=line_sdl_2)  # -> Start, End
round_to_decimal_place_2 = RoundToDecimalPlace(NumberX=trip_amenityscore.Amenityscore, DecimalPlace="2", RoundType=0)  # -> Rounded, Difference
flip_curve = FlipCurve(Curve=move.Geometry)  # -> Curve, Flag
line_sdl_3 = LineSDL(Start=end_points.End, Direction=unit_z_5, Length=Slider(50, range=0..100))
area_5 = Area(Geometry=cap_holes_3)  # -> Area, Centroid
text_on_surface_2 = TextOnSurface(
    Text=round_to_decimal_place.Rounded,
    Font="Sans Bold:no Italic:no",
    Height=number_slider_2,
    Depth=number_slider_2,
    BaseLine=flip_curve.Curve,
    BaseSurface=brep)
end_points_2 = EndPoints(Curve=line_sdl_3)  # -> Start, End
triangulate = Triangulate(Mesh=cap_holes_3)  # -> Mesh, Count
custom_preview = CustomPreview(Geometry=line_sdl_3, Material=gradient_2)
geometry_14 = Geometry(flatten(text_on_surface_2))
curve_middle = CurveMiddle(Curve=line_sdl_3)
area_6 = Area(Geometry=triangulate.Mesh)  # -> Area, Centroid
text_on_surface_3 = TextOnSurface(
    Text=inspect_amenity.Activities,
    Font="Sans Bold:no Italic:no",
    Height=Slider(3, range=0..10),
    Depth=0.4,
    BaseLine=line_sdl_3)  # -> flatten(Symbols)
number_slider_3 = Slider(4, range=0..10)

# ---- group: RH_OUT:Street Hits
geometry_15 = Geometry(geometry_14)

# ----
yz_plane = YZPlane(Origin=end_points_2.End)
mesh_spray_2 = MeshSpray(Mesh=triangulate.Mesh, Points=area_6.Centroid, Colours=gradient_2, SprayMode=0)
pipe_2 = Pipe(Curve=line_sdl_3, Radius=Slider(0.1, range=0..0.1), Caps=Slider(2, range=0..2))

# ---- group: RH_OUT:Street Loads
geometry_16 = Geometry(brep)

# ----
plane_surface = PlaneSurface(Plane=yz_plane, XSize=number_slider_3, YSize=number_slider_3)
mesh_colours_3 = MeshColours(Mesh=text_on_surface_3, Colours=gradient_2)
mesh_colours_4 = MeshColours(Mesh=pipe_2, Colours=gradient_2)
text_on_surface_4 = TextOnSurface(
    Text=round_to_decimal_place_2.Rounded,
    Font="Sans Bold:no Italic:no",
    Height=Slider(4, range=0..10),
    Depth=0.4,
    BaseLine=line_sdl_3,
    BaseSurface=plane_surface)  # -> flatten(Symbols)
unit_z_6 = UnitZ(Factor=Slider(28, range=0..100))
move_2 = Move(Geometry=text_on_surface_4, Motion=unit_z_6)  # -> Geometry, Transform
geometry_17 = Geometry(flatten(mesh_spray_2))
geometry_18 = Geometry(flatten(mesh_colours_4))
mesh_colours_5 = MeshColours(Mesh=move_2.Geometry, Colours=gradient_2)
geometry_19 = Geometry(flatten(mesh_colours_3))
geometry_20 = Geometry(flatten(mesh_colours_5))

# ---- group: RH_OUT:Amenities
geometry_21 = Geometry(geometry_19)

# ---- group: RH_OUT:Amenities Scores
geometry_22 = Geometry(geometry_20)

# ---- group: RH_OUT:Amenities Pipes
geometry_23 = Geometry(geometry_18)

# ---- group: RH_OUT:Amenities Buildings
geometry_24 = Geometry(geometry_17)
